# Grasshopper definition playerinvestigator.gh (Grasshopper 0.9.14)

path = FilePath("C:\Users\MRS\Documents\Dropbox\Coding\Processing\FastMapPresentation\Untit.txt")
file = ReadFile(Path=path, Lines=True)
split = StringSplit(String=file, Separators=",")
item = ListItem(List=split, Index=0, Wrap=False)
item_2 = ListItem(List=split, Index=2, Wrap=False)
flip = FlipMatrix(Data=item_2)
lng = ListLength(List=flip)
series = Series(Start=0, Step=1, Count=lng)
item_3 = ListItem(List=split, Index=1, Wrap=False)
flip_2 = FlipMatrix(Data=series)
panel = Panel(file)
pt = PointXYZ(XComponent=item_3, YComponent=item_2, ZComponent=0, System=PlaneXY(0, 0, 0))
flip_3 = FlipMatrix(Data=pt)
slider = Slider(2992, range=0..3886)
panel_2 = Panel(split)
dom = Domain(DomainStart=Slider(0, range=0..3000), DomainEnd=Slider(3000, range=0..3000))
subset = SubList(List=flip_3, Domain=dom, Cycle=False)  # -> List, Index
item_4 = ListItem(List=flip_3, Index=dom, Wrap=False)
range = Range(Domain=Domain(0, 1), Steps=10)
